# Dynamo graph QAQC_Parametros_Nomenclatura.dyn (Dynamo 3.3.0.6316)
# author: Grupo EC2 · MBIM301
# EC2 MBIM301 · Rutina QA/QC: audita y corrige parámetros requeridos y nomenclatura de tipos según reglas en CSV, con reporte trazable y resaltado en vista.

# group: 1 · ENTRADAS
# Parámetros de la rutina (Dynamo Player)
n1_archivo_de_reglas_csv = Filename("C:\EC2-QAQC-Dynamo\config\reglas_qaqc.csv")  # "1 · Archivo de reglas (CSV)"; graph input
n2_escribir_en_el_modelo_false = BoolSelector(false)  # "2 · Escribir en el modelo (False = solo auditar)"; graph input
n3_resaltar_en_vista_activa = BoolSelector(true)  # "3 · Resaltar en vista activa"; graph input
# note: Estos 4 nodos son los únicos que edita el usuario (aparecen en Dynamo Player). Ejecutar SIEMPRE primero con 'Escribir' = False, revisar el reporte y luego pasar a True.
n4_carpeta_de_reportes = Directory("C:\EC2-QAQC-Dynamo\reportes")  # "4 · Carpeta de reportes"; graph input

# group: 2 · LECTURA Y VALIDACIÓN DE REGLAS
# Python · sin Revit API
py_01_leer_y_validar_reglas = Python(IN[0]=n1_archivo_de_reglas_csv)  # CPython3
# ---------- py_01_leer_y_validar_reglas.python (146 lines) ----------
# -*- coding: utf-8 -*-
"""
NODO 01 - LEER Y VALIDAR REGLAS
===============================
Rutina QA/QC de parámetros y nomenclatura - EC2 MBIM301

Entradas
    IN[0]  ruta del archivo CSV de reglas (str)

Salida
    OUT = [reglas, errores]
        reglas  : list[list[str]]  una fila por regla válida, en el orden de COLUMNAS
        errores : list[str]        filas rechazadas y el motivo

Este nodo NO toca el modelo de Revit. Si una regla está mal escrita
(columna vacía, operador desconocido, expresión regular inválida...)
se descarta aquí y se reporta, en lugar de fallar a mitad de la auditoría.

Compatible con los motores CPython3 / PythonNet3 (Dynamo 2.13+ / 3.x).
"""
import csv
import io
import re

COLUMNAS = [
    "id", "tipo", "categoria", "parametro", "operador", "valor",
    "filtro_parametro", "filtro_operador", "filtro_valor",
    "sobrescribir", "severidad", "descripcion",
]

# Operadores permitidos por tipo de regla
OPERADORES = {
    "VERIFICAR": ("NO_VACIO", "IGUAL", "EN_LISTA", "REGEX"),
    "ASIGNAR": ("FIJAR",),
}
OPERADORES_FILTRO = ("", "CONTIENE", "IGUAL", "EN_LISTA", "REGEX", "NO_VACIO")
SEVERIDADES = ("ALTA", "MEDIA", "BAJA")


def leer_texto(ruta):
    """Lee el CSV aceptando UTF-8 (con o sin BOM) y ANSI/Windows-1252,
    que es lo que guarda Excel en Windows en español."""
    try:
        with io.open(ruta, "r", encoding="utf-8-sig") as f:
            return f.read()
    except UnicodeDecodeError:
        with io.open(ruta, "r", encoding="cp1252") as f:
            return f.read()


def _regex_valida(patron):
    try:
        re.compile(patron)
        return True
    except re.error:
        return False


def validar_regla(r, ids_vistos):
    """Devuelve None si la regla es válida o un texto con el problema."""
    if not r["id"]:
        return "falta el id"
    if r["id"] in ids_vistos:
        return "id duplicado"
    if r["tipo"] not in OPERADORES:
        return "tipo '%s' no válido (use VERIFICAR o ASIGNAR)" % r["tipo"]
    if not r["categoria"].startswith("OST_"):
        return "categoría '%s' debe ser un BuiltInCategory (ej. OST_Walls)" % r["categoria"]
    if not r["parametro"]:
        return "falta el parámetro"
    if r["operador"] not in OPERADORES[r["tipo"]]:
        return "operador '%s' no válido para %s (use %s)" % (
            r["operador"], r["tipo"], ", ".join(OPERADORES[r["tipo"]]))
    if r["operador"] != "NO_VACIO" and not r["valor"]:
        return "falta el valor"
    if r["operador"] == "REGEX" and not _regex_valida(r["valor"]):
        return "expresión regular inválida en 'valor'"
    if r["tipo"] == "ASIGNAR" and r["parametro"].upper() == "TIPO:NOMBRE":
        return "no se permite renombrar tipos con ASIGNAR"
    if r["filtro_operador"] not in OPERADORES_FILTRO:
        return "filtro_operador '%s' no válido" % r["filtro_operador"]
    if bool(r["filtro_operador"]) != bool(r["filtro_parametro"]):
        return "filtro incompleto: indique filtro_parametro y filtro_operador juntos"
    if r["filtro_operador"] not in ("", "NO_VACIO") and not r["filtro_valor"]:
        return "falta filtro_valor"
    if r["filtro_operador"] == "REGEX" and not _regex_valida(r["filtro_valor"]):
        return "expresión regular inválida en 'filtro_valor'"
    if r["severidad"] not in SEVERIDADES:
        return "severidad '%s' no válida (ALTA, MEDIA o BAJA)" % r["severidad"]
    if r["sobrescribir"] not in ("SI", "NO"):
        return "sobrescribir debe ser SI o NO"
    return None


def parsear_reglas(texto):
    """Convierte el texto del CSV en (reglas, errores)."""
    lineas = [l for l in texto.splitlines()
              if l.strip() and not l.lstrip().startswith("#")]
    if not lineas:
        return [], ["El archivo de reglas está vacío."]

    # Excel en configuración regional Perú/España separa con ';'
    delim = ";" if lineas[0].count(";") >= lineas[0].count(",") else ","
    filas = list(csv.reader(lineas, delimiter=delim))

    encabezado = [c.strip().lower() for c in filas[0]]
    faltan = [c for c in COLUMNAS if c not in encabezado]
    if faltan:
        return [], ["Faltan columnas en el encabezado: " + ", ".join(faltan)]
    idx = dict((c, encabezado.index(c)) for c in COLUMNAS)

    reglas, errores, ids = [], [], set()
    for n, fila in enumerate(filas[1:], start=2):
        fila = fila + [""] * (len(encabezado) - len(fila))
        r = dict((c, fila[idx[c]].strip()) for c in COLUMNAS)
        for c in ("tipo", "operador", "filtro_operador", "severidad", "sobrescribir"):
            r[c] = r[c].upper()
        r["severidad"] = r["severidad"] or "MEDIA"
        r["sobrescribir"] = (r["sobrescribir"] or "NO").replace("SÍ", "SI")

        problema = validar_regla(r, ids)
        if problema:
            errores.append("Fila %d (%s): %s" % (n, r["id"] or "sin id", problema))
            continue
        ids.add(r["id"])
        reglas.append([r[c] for c in COLUMNAS])

    if not reglas:
        errores.append("No quedó ninguna regla válida.")
    return reglas, errores


def ejecutar(ruta):
    if not ruta:
        return [[], ["No se indicó el archivo de reglas."]]
    try:
        texto = leer_texto(str(ruta))
    except (IOError, OSError) as ex:
        return [[], ["No se pudo leer el archivo de reglas: %s" % ex]]
    reglas, errores = parsear_reglas(texto)
    return [reglas, errores]


# --- Punto de entrada del nodo Python de Dynamo --------------------------
if "IN" in globals():
    OUT = ejecutar(IN[0])  # noqa: F821  (IN lo define Dynamo)
# ----------------------------------------
# note: No toca el modelo. Si una regla está mal escrita se descarta aquí y se lista en el Watch; las demás siguen. Formato de reglas: ver README y config/reglas_qaqc.csv.
reglas_válidas_errores = Watch(py_01_leer_y_validar_reglas)  # graph output

# group: 3 · AUDITORÍA Y CORRECCIÓN
# Python · Revit API · transacción única
# note: Único nodo que escribe en Revit, dentro de una sola transacción. Controla: parámetro inexistente, solo lectura, elementos en grupos, elementos tomados por otro usuario, parámetros de tipo (se escriben una vez) y errores de la API por elemento.
py_02_auditar_y_corregir_revit = Python(IN[0]=py_01_leer_y_validar_reglas, IN[1]=n2_escribir_en_el_modelo_false, IN[2]=n3_resaltar_en_vista_activa)  # "PY 02 · Auditar y corregir (Revit API)"; CPython3
# ---------- py_02_auditar_y_corregir_revit.python (417 lines) ----------
# -*- coding: utf-8 -*-
"""
NODO 02 - AUDITAR Y CORREGIR (Revit API)
========================================
Rutina QA/QC de parámetros y nomenclatura - EC2 MBIM301

Entradas
    IN[0]  salida completa del NODO 01: [reglas, errores]
    IN[1]  escribir (bool)  False = solo auditar, NO modifica el modelo
    IN[2]  resaltar (bool)  True  = colorea en la vista activa:
                                     rojo = falla / pendiente / error
                                     ámbar = omitido (grupo, solo lectura, prestado)
                                     sin color = cumple

Salida
    OUT = [tabla, resumen, mensaje, proyecto]
        tabla    : list[list]  detalle elemento por regla (1.ª fila = encabezado)
        resumen  : list[list]  cumplimiento por regla (1.ª fila = encabezado)
        mensaje  : str         resumen legible para el Watch / Dynamo Player
        proyecto : str         título del modelo (para nombrar el reporte)

Resultados posibles por fila
    OK         cumple la regla
    CORREGIDO  la rutina escribió el valor (solo con escribir = True)
    PENDIENTE  no cumple y se corregiría con escribir = True
    FALLA      no cumple una regla de VERIFICAR
    OMITIDO    no se pudo escribir por una condición controlada
    ERROR      excepción de la API o parámetro inexistente
    INFO       la categoría no tiene elementos en el modelo

Compatible con los motores CPython3 / PythonNet3 (Revit 2022-2026).
"""
import re

import clr
clr.AddReference("RevitAPI")
clr.AddReference("RevitServices")
import Autodesk.Revit.DB as DB  # noqa: E402
from RevitServices.Persistence import DocumentManager  # noqa: E402
from RevitServices.Transactions import TransactionManager  # noqa: E402

COLUMNAS_REGLA = [
    "id", "tipo", "categoria", "parametro", "operador", "valor",
    "filtro_parametro", "filtro_operador", "filtro_valor",
    "sobrescribir", "severidad", "descripcion",
]
ENCABEZADO = [
    "regla_id", "severidad", "categoria", "element_id", "unique_id",
    "familia_tipo", "parametro", "origen", "valor_actual", "valor_esperado",
    "resultado", "detalle",
]
ESTADOS = ["OK", "CORREGIDO", "PENDIENTE", "FALLA", "OMITIDO", "ERROR"]
ROJO = ("PENDIENTE", "FALLA", "ERROR")
AMBAR = ("OMITIDO",)


# ---------------------------------------------------------------------------
# Lógica pura (sin Revit) - probada con pytest en /tests
# ---------------------------------------------------------------------------
def cumple(valor, operador, esperado):
    """Evalúa un valor (texto) contra un operador de la regla."""
    valor = (valor or "").strip()
    esperado = (esperado or "").strip()
    op = (operador or "").upper()
    if op == "NO_VACIO":
        return valor != ""
    if op == "IGUAL":
        return valor.lower() == esperado.lower()
    if op == "CONTIENE":
        return esperado.lower() in valor.lower()
    if op == "EN_LISTA":
        return valor.lower() in [x.strip().lower() for x in esperado.split("|") if x.strip()]
    if op == "REGEX":
        return re.search(esperado, valor) is not None
    raise ValueError("Operador no soportado: %s" % operador)


def resumir(filas):
    """Tabla de cumplimiento por regla + fila TOTAL."""
    orden, conteo, desc = [], {}, {}
    for f in filas:
        rid, res = f[0], f[10]
        if rid not in conteo:
            orden.append(rid)
            conteo[rid] = dict((e, 0) for e in ESTADOS)
        if res in conteo[rid]:
            conteo[rid][res] += 1
    encabezado = ["regla_id", "evaluados"] + ESTADOS + ["cumplimiento_%"]
    tabla = [encabezado]
    total = dict((e, 0) for e in ESTADOS)
    for rid in orden:
        c = conteo[rid]
        n = sum(c.values())
        for e in ESTADOS:
            total[e] += c[e]
        tabla.append([rid, n] + [c[e] for e in ESTADOS] + [_pct(c, n)])
    n_total = sum(total.values())
    tabla.append(["TOTAL", n_total] + [total[e] for e in ESTADOS] + [_pct(total, n_total)])
    return tabla


def _pct(c, n):
    if n == 0:
        return ""
    return round(100.0 * (c["OK"] + c["CORREGIDO"]) / n, 1)


# ---------------------------------------------------------------------------
# Utilidades de Revit API
# ---------------------------------------------------------------------------
def id_entero(element_id):
    """ElementId -> int. Revit 2024+ usa .Value; versiones previas .IntegerValue."""
    try:
        return int(element_id.Value)
    except AttributeError:
        return int(element_id.IntegerValue)


def nombre_de_tipo(tipo):
    """Nombre del tipo sin depender de .Name (falla en CPython3 con FamilySymbol)."""
    if tipo is None:
        return ""
    for nombre_bip in ("SYMBOL_NAME_PARAM", "ALL_MODEL_TYPE_NAME"):
        bip = getattr(DB.BuiltInParameter, nombre_bip, None)
        if bip is None:
            continue
        p = tipo.get_Parameter(bip)
        if p is not None and p.HasValue:
            s = p.AsString()
            if s:
                return s
    try:
        return tipo.Name
    except Exception:
        return ""


def familia_y_tipo(tipo):
    nombre = nombre_de_tipo(tipo)
    try:
        familia = tipo.FamilyName if tipo is not None else ""
    except Exception:
        familia = ""
    return "%s: %s" % (familia, nombre) if familia else nombre


def valor_texto(p):
    """Valor del parámetro como texto, sea String, Integer, Double o ElementId."""
    if p is None or not p.HasValue:
        return ""
    st = p.StorageType
    if st == DB.StorageType.String:
        return p.AsString() or ""
    if st == DB.StorageType.ElementId:
        if p.AsElementId() == DB.ElementId.InvalidElementId:
            return ""
        return p.AsValueString() or ""
    v = p.AsValueString()
    if v:
        return v
    if st == DB.StorageType.Integer:
        return str(p.AsInteger())
    if st == DB.StorageType.Double:
        return str(p.AsDouble())
    return ""


def fijar_valor(p, texto):
    """Escribe respetando el tipo de almacenamiento. Devuelve True si Revit lo aceptó."""
    st = p.StorageType
    if st == DB.StorageType.String:
        return bool(p.Set(texto))
    if st == DB.StorageType.Integer:
        return bool(p.Set(int(texto)))
    if st == DB.StorageType.Double:
        # SetValueString interpreta el texto en las unidades del proyecto
        return bool(p.SetValueString(texto))
    return False  # ElementId: no se asigna por texto


def resolver_lector(spec):
    """Convierte 'BIP:FIRE_RATING' / 'TIPO:NOMBRE' / 'Nombre visible' en una función.
    Los BuiltInParameter no dependen del idioma de Revit; los nombres visibles sí."""
    s = spec.strip()
    if s.upper() == "TIPO:NOMBRE":
        return "TIPO:NOMBRE"
    if s.upper().startswith("BIP:"):
        bip = getattr(DB.BuiltInParameter, s[4:].strip(), None)
        if bip is None:
            raise ValueError("BuiltInParameter desconocido: %s" % s)
        return lambda e: e.get_Parameter(bip)
    return lambda e: e.LookupParameter(s)


def buscar_parametro(el, tipo, lector):
    """Busca primero en la instancia y luego en el tipo.
    Devuelve (parametro, origen, valor_texto, existe)."""
    if lector == "TIPO:NOMBRE":
        return None, "tipo", nombre_de_tipo(tipo), True
    for origen, e in (("instancia", el), ("tipo", tipo)):
        if e is None:
            continue
        p = lector(e)
        if p is not None:
            return p, origen, valor_texto(p), True
    return None, "", "", False


def prestado_por_otro(doc, elemento):
    """True si en un modelo colaborativo el elemento lo tiene otro usuario
    o está desactualizado respecto al central (escribir generaría conflicto)."""
    if not doc.IsWorkshared:
        return False
    try:
        if DB.WorksharingUtils.GetCheckoutStatus(doc, elemento.Id) == DB.CheckoutStatus.OwnedByOtherUser:
            return True
        estado = DB.WorksharingUtils.GetModelUpdatesStatus(doc, elemento.Id)
        return estado == DB.ModelUpdatesStatus.UpdatedInCentral
    except Exception:
        return False


# ---------------------------------------------------------------------------
# Motor de reglas
# ---------------------------------------------------------------------------
class Auditoria(object):
    def __init__(self, doc, escribir):
        self.doc = doc
        self.escribir = escribir
        self.filas = []
        self.estado_elemento = {}   # id_int -> (ElementId, peor estado)
        self.tipos_escritos = {}    # (regla_id, id_tipo) -> valor escrito

    def fila(self, r, el=None, tipo_txt="", origen="", actual="", esperado="",
             resultado="OK", detalle=""):
        eid, uid = "", ""
        if el is not None:
            eid = id_entero(el.Id)
            uid = el.UniqueId
            self._marcar(el.Id, eid, resultado)
        self.filas.append([r["id"], r["severidad"], r["categoria"], eid, uid, tipo_txt,
                           r["parametro"], origen, actual, esperado, resultado, detalle])

    def _marcar(self, element_id, eid, resultado):
        previo = self.estado_elemento.get(eid)
        rango = {"OK": 0, "CORREGIDO": 0, "INFO": 0, "OMITIDO": 1}
        if previo is None or rango.get(resultado, 2) > rango.get(previo[1], 2):
            self.estado_elemento[eid] = (element_id, resultado)

    def procesar(self, r):
        bic = getattr(DB.BuiltInCategory, r["categoria"], None)
        if bic is None:
            self.fila(r, resultado="ERROR", detalle="Categoría no existe en esta versión de Revit")
            return
        try:
            lector = resolver_lector(r["parametro"])
            lector_filtro = resolver_lector(r["filtro_parametro"]) if r["filtro_parametro"] else None
        except ValueError as ex:
            self.fila(r, resultado="ERROR", detalle=str(ex))
            return

        elementos = list(DB.FilteredElementCollector(self.doc).OfCategory(bic)
                         .WhereElementIsNotElementType().ToElements())
        evaluados = 0
        for el in elementos:
            try:
                tipo = self.doc.GetElement(el.GetTypeId())
                if lector_filtro is not None:
                    _, _, v_filtro, existe = buscar_parametro(el, tipo, lector_filtro)
                    if not existe or not cumple(v_filtro, r["filtro_operador"], r["filtro_valor"]):
                        continue
                evaluados += 1
                if r["tipo"] == "VERIFICAR":
                    self._verificar(r, el, tipo, lector)
                else:
                    self._asignar(r, el, tipo, lector)
            except Exception as ex:  # una excepción no detiene la auditoría
                self.fila(r, el, resultado="ERROR", detalle="Excepción: %s" % ex)

        if evaluados == 0:
            detalle = ("Ningún elemento cumple el filtro" if lector_filtro is not None
                       else "La categoría no tiene elementos en el modelo")
            self.fila(r, resultado="INFO", detalle=detalle)

    def _verificar(self, r, el, tipo, lector):
        p, origen, actual, existe = buscar_parametro(el, tipo, lector)
        tipo_txt = familia_y_tipo(tipo)
        esperado = r["valor"] or "(no vacío)"
        if not existe:
            self.fila(r, el, tipo_txt, "", "", esperado, "ERROR",
                      "Parámetro inexistente en instancia y tipo")
        elif cumple(actual, r["operador"], r["valor"]):
            self.fila(r, el, tipo_txt, origen, actual, esperado, "OK")
        else:
            self.fila(r, el, tipo_txt, origen, actual, esperado, "FALLA", r["descripcion"])

    def _asignar(self, r, el, tipo, lector):
        p, origen, actual, existe = buscar_parametro(el, tipo, lector)
        tipo_txt = familia_y_tipo(tipo)
        nuevo = r["valor"]
        f = lambda res, det="": self.fila(r, el, tipo_txt, origen, actual, nuevo, res, det)

        if not existe:
            return f("ERROR", "Parámetro inexistente en instancia y tipo")
        dueno = el if origen == "instancia" else tipo
        clave_tipo = (r["id"], id_entero(tipo.Id)) if origen == "tipo" and tipo is not None else None

        if clave_tipo in self.tipos_escritos:
            return f("CORREGIDO", "Asignado a nivel de tipo (afecta a todas sus instancias)")
        if actual.strip() and r["sobrescribir"] == "NO":
            return f("OK", "Ya tenía valor; no se sobrescribe")
        if actual.strip() == nuevo.strip():
            return f("OK")
        if not self.escribir:
            return f("PENDIENTE", "Se asignaría '%s' (modo auditoría)" % nuevo)
        if p.IsReadOnly:
            return f("OMITIDO", "Parámetro de solo lectura")
        if origen == "instancia" and el.GroupId != DB.ElementId.InvalidElementId:
            return f("OMITIDO", "Elemento dentro de un grupo: editar el grupo manualmente")
        if prestado_por_otro(self.doc, dueno):
            return f("OMITIDO", "Elemento tomado por otro usuario o desactualizado (sincronizar)")
        try:
            ok = fijar_valor(p, nuevo)
        except Exception as ex:
            return f("ERROR", "Revit rechazó el valor: %s" % ex)
        if not ok:
            return f("ERROR", "Revit rechazó el valor (tipo de dato incompatible)")
        if clave_tipo is not None:
            self.tipos_escritos[clave_tipo] = nuevo
        f("CORREGIDO", "Valor asignado" + (" al tipo" if origen == "tipo" else ""))

    def resaltar(self):
        """Colorea el resultado en la vista activa. Devuelve un texto de estado."""
        vista = self.doc.ActiveView
        if vista is None or not vista.AreGraphicsOverridesAllowed():
            return "Vista activa no admite modificaciones gráficas (plantilla o tipo de vista)"
        solido = None
        for fp in DB.FilteredElementCollector(self.doc).OfClass(DB.FillPatternElement):
            if fp.GetFillPattern().IsSolidFill:
                solido = fp.Id
                break

        def ogs(r, g, b):
            o = DB.OverrideGraphicSettings()
            color = DB.Color(r, g, b)
            o.SetProjectionLineColor(color)
            if solido is not None:
                o.SetSurfaceForegroundPatternId(solido)
                o.SetSurfaceForegroundPatternColor(color)
            return o

        rojo, ambar, limpio = ogs(220, 40, 40), ogs(240, 160, 0), DB.OverrideGraphicSettings()
        pintados, fallidos = 0, 0
        for element_id, estado in self.estado_elemento.values():
            o = rojo if estado in ROJO else ambar if estado in AMBAR else limpio
            try:
                vista.SetElementOverrides(element_id, o)
                pintados += 1
            except Exception:
                fallidos += 1
        return "Vista '%s': %d elementos coloreados%s" % (
            vista.Name, pintados, (", %d no admitidos" % fallidos) if fallidos else "")


def ejecutar(salida_nodo01, escribir, resaltar):
    reglas_raw, errores_reglas = [], []
    try:
        salida_nodo01 = list(salida_nodo01 or [])  # tolera listas .NET de Dynamo
        if len(salida_nodo01) == 2:
            reglas_raw = [list(f) for f in (salida_nodo01[0] or [])]
            errores_reglas = [str(e) for e in (salida_nodo01[1] or [])]
    except TypeError:
        errores_reglas = ["La entrada IN[0] no es la salida del NODO 01"]
    reglas = [dict(zip(COLUMNAS_REGLA, fila)) for fila in reglas_raw if len(fila) == len(COLUMNAS_REGLA)]
    if not reglas:
        msg = ("SIN REGLAS VÁLIDAS: no se auditó el modelo ni se generó reporte.\n"
               "Motivo: " + (" | ".join(errores_reglas) or "el NODO 01 no devolvió reglas") + "\n"
               "Verifique la ruta del archivo de reglas en el grupo 1 · ENTRADAS.")
        return [[ENCABEZADO], resumir([]), msg, ""]

    doc = DocumentManager.Instance.CurrentDBDocument
    escribir, resaltar = bool(escribir), bool(resaltar)
    auditoria = Auditoria(doc, escribir)
    estado_vista = ""

    necesita_transaccion = escribir or resaltar
    if necesita_transaccion:
        TransactionManager.Instance.EnsureInTransaction(doc)
    try:
        for r in reglas:
            auditoria.procesar(r)
        if resaltar:
            estado_vista = auditoria.resaltar()
    finally:
        if necesita_transaccion:
            TransactionManager.Instance.TransactionTaskDone()

    resumen = resumir(auditoria.filas)
    total = resumen[-1]
    partes = [
        "Modelo: %s" % doc.Title,
        "Modo: %s" % ("CORRECCIÓN" if escribir else "AUDITORÍA (sin cambios)"),
        "Reglas aplicadas: %d" % len(reglas),
        "Evaluaciones: %s" % total[1],
        "Cumplimiento global: %s%%" % total[-1],
        "Corregidos: %s | Pendientes: %s | Fallas: %s | Omitidos: %s | Errores: %s" % tuple(total[3:8]),
    ]
    if errores_reglas:
        partes.append("Reglas descartadas: %d (ver NODO 01)" % len(errores_reglas))
    if estado_vista:
        partes.append(estado_vista)
    return [[ENCABEZADO] + auditoria.filas, resumen, "\n".join(partes), doc.Title]


# --- Punto de entrada del nodo Python de Dynamo --------------------------
if "IN" in globals():
    OUT = ejecutar(IN[0], IN[1], IN[2])  # noqa: F821
# ----------------------------------------

# group: 4 · REPORTE Y RESULTADOS
# Python · exportación CSV + Watch
separar_mensaje_resumen = CodeBlock(resultado=py_02_auditar_y_corregir_revit) { resultado[2]; resultado[1]; }
RESULTADO = Watch(separar_mensaje_resumen.out0)  # graph output
# note: Genera _detalle.csv y _resumen.csv con fecha y hora (no sobrescribe). Separador ';' para Excel en configuración regional Perú.
cumplimiento_por_regla = Watch(separar_mensaje_resumen.out1)  # graph output
py_03_exportar_reporte_csv = Python(IN[0]=py_02_auditar_y_corregir_revit, IN[1]=n4_carpeta_de_reportes)  # CPython3
# ---------- py_03_exportar_reporte_csv.python (62 lines) ----------
# -*- coding: utf-8 -*-
"""
NODO 03 - EXPORTAR REPORTE
==========================
Rutina QA/QC de parámetros y nomenclatura - EC2 MBIM301

Entradas
    IN[0]  salida completa del NODO 02: [tabla, resumen, mensaje, proyecto]
    IN[1]  carpeta de salida (str)

Salida
    OUT = [ruta_detalle, ruta_resumen]  o un texto de error

Genera dos CSV con separador ';' y codificación UTF-8 con BOM, para que
Excel en configuración regional Perú/España los abra directamente con
tildes y columnas correctas. El nombre incluye fecha y hora: cada
ejecución deja trazabilidad y nunca sobrescribe un reporte anterior.
"""
import csv
import datetime
import io
import os
import re


def nombre_seguro(texto):
    texto = re.sub(r"\.rvt$", "", texto or "modelo", flags=re.I)
    return re.sub(r"[^A-Za-z0-9_-]+", "_", texto).strip("_")[:60] or "modelo"


def escribir_csv(ruta, filas):
    with io.open(ruta, "w", encoding="utf-8-sig", newline="") as f:
        w = csv.writer(f, delimiter=";")
        for fila in filas:
            w.writerow(["" if v is None else v for v in fila])


def ejecutar(salida_nodo02, carpeta, ahora=None):
    if not salida_nodo02 or len(salida_nodo02) < 4:
        return "Sin datos del NODO 02: revise la auditoría."
    tabla, resumen, mensaje, proyecto = salida_nodo02[:4]
    if len(tabla) <= 1:
        return "No se generó reporte: la auditoría no evaluó ningún elemento. " + str(mensaje)
    if not carpeta:
        return "Indique la carpeta de salida."
    carpeta = str(carpeta)
    try:
        if not os.path.isdir(carpeta):
            os.makedirs(carpeta)
        sello = (ahora or datetime.datetime.now()).strftime("%Y%m%d_%H%M%S")
        base = os.path.join(carpeta, "QAQC_%s_%s" % (nombre_seguro(proyecto), sello))
        ruta_detalle, ruta_resumen = base + "_detalle.csv", base + "_resumen.csv"
        escribir_csv(ruta_detalle, tabla)
        escribir_csv(ruta_resumen, resumen)
        return [ruta_detalle, ruta_resumen]
    except (IOError, OSError) as ex:
        return "No se pudo escribir el reporte (¿archivo abierto en Excel o carpeta sin permisos?): %s" % ex


# --- Punto de entrada del nodo Python de Dynamo --------------------------
if "IN" in globals():
    OUT = ejecutar(IN[0], IN[1])  # noqa: F821
# ----------------------------------------
reportes_generados = Watch(py_03_exportar_reporte_csv)  # graph output
